# Grasshopper definition elk test 19 feb 2019.gh (Grasshopper 1.0.7)
# plug-ins: ElkGHComponents

invoer_osm_data = FilePath("G:\cad\1. cad projecten\grasshopper 2019\osm elk lonnekerberg feb 2019\lonneker enschede noord 19 feb 2019")
# links: https://www.food4rhino.com/app/elk
loc = Location(FilePathText=invoer_osm_data)  # -> OSMPointData, OSMFile, LongitudeDomain, LatitudeDomain
panel = Panel(loc.LongitudeDomain)
panel_2 = Panel(loc.LatitudeDomain)
# haal de data uit open street map:
# OpenStreetMap.org
# 
# om kaart data te downloaden: selectgeer export, teken rechthoek en sla data op
panel_3 = Panel(loc.OSMFile)
invoer_osm_data_2 = FilePath(invoer_osm_data)
osm = OSMData(
    OSMPointData=loc.OSMPointData,
    OSMFilePath=invoer_osm_data_2,
    Feature="route",
    Generate3d=False,
    IndividualOutputs=True,
    SelectedTypes=["bicycle", "hiking", "road"])  # -> Bicycle, Hiking, Road, FeatureKey
building = OSMData(
    OSMPointData=loc.OSMPointData,
    OSMFilePath=invoer_osm_data_2,
    Feature="building",
    Generate3d=False,
    IndividualOutputs=False)  # -> Ways, FeatureKey
panel_4 = Panel(osm.Bicycle)
pline = PolyLine(Vertices=osm.Hiking, Closed=False)
pline_2 = PolyLine(Vertices=building.Ways, Closed=False)
