# Grasshopper definition boxmaker grasshopper wout zweers english clustered.gh (Grasshopper 0.9.75)

# ----
# front:
# height x width
# 
# side:
# heigth x depth
# 
# top:
# width x depth
# 
# joints in height:
# nr joints side and top
# 
# joints in width:
# nr joints top and front
# 
# joints in depth:
# nr joints side and top
nr_joints_top_and_front = Slider(15, range=1..31)
nr_joints_side_and_front = Slider(7, range=1..31)
nr_joints_side_and_top = Slider(9, range=1..31)
material_thickness = Slider(3, range=0..20)
cut_width = Slider(0.1, range=0..3)

height_y = Slider(30, range=0..410)
width_x = Slider(100, range=0..710)
depth_z = Slider(60, range=0..410)

cluster = Boxmaker(
    material_thickness=material_thickness,
    depth=depth_z,
    width=width_x,
    cutting_width=cut_width,
    h_pen=nr_joints_top_and_front,
    b_pen=nr_joints_side_and_front,
    d_pen=nr_joints_side_and_top,
    hoogte_7=height_y,
    x=material_thickness,
    depth_2=depth_z,
    material_thickness_3=material_thickness,
    depth_5=depth_z,
    height=height_y,
    material_thickness_4=material_thickness,
    width_3=width_x,
    height_2=height_y,
    b_joint=nr_joints_side_and_front,
    h_joint=nr_joints_top_and_front)  # -> C, C_3, C_2

front_bake = Curve(cluster.C_2)
top_bake = Curve(cluster.C)
side_bake = Curve(cluster.C_3)

# ---- group: tag
tag = Tag(T=cluster.C, T_2=cluster.C_3, C=cluster.C_2)  # -> S_3, panel_5, S_2, panel_4, S, panel
tag_2 = TextTag(Location=tag.S_3, Text=tag.panel_5)
tag_3 = TextTag(Location=tag.S_2, Text=tag.panel_4)
tag_4 = TextTag(Location=tag.S, Text=tag.panel)

# ==== cluster Boxmaker
cutting_width = ClusterInput()
h_pen = ClusterInput()
d_pen = ClusterInput()
x = ClusterInput()
b_pen = ClusterInput()
h_pen_2 = Integer(h_pen)
neg = Negative(Value=x)
cutting_width_2 = Number(cutting_width)
d_pen_2 = Integer(d_pen)
b_pen_2 = Integer(b_pen)
material_thickness = ClusterInput()
depth = ClusterInput()
depth_2 = ClusterInput()
width = ClusterInput()
depth_3 = Number(depth)
# top:
# width x depth
# 
# joints (dutch: pen):
# h joint and d joints
material_thickness_2 = Number(material_thickness)
joints_vertical = Integer(h_pen_2)
cutting_width_3 = Number(cutting_width_2)
depth_4 = Number(depth_2)
joints_horizontal = Integer(d_pen_2)
width_2 = Number(width)
depth_5 = ClusterInput()
material_thickness_3 = ClusterInput()
height = ClusterInput()
width_3 = ClusterInput()
material_thickness_4 = ClusterInput()
b_joint = ClusterInput()
h_joint = ClusterInput()
height_2 = ClusterInput()
panel = Panel(width_2)
panel_2 = Panel(joints_vertical)
panel_3 = Panel(depth_3)
panel_4 = Panel(joints_horizontal)
panel_5 = Panel(material_thickness_2)
panel_6 = Panel(cutting_width_3)
depth_6 = Number(depth_5)
# side:
# height x depth
# 
# joints:
# h pen en d pen
material_thickness_5 = Number(material_thickness_3)
thickness_cut = Number(cutting_width_2)
joint_vertical = Integer(b_pen_2)
joint_horizontal = Integer(d_pen_2)
height_3 = Number(height)
width_4 = Number(width_3)
material_thickness_6 = Number(material_thickness_4)
b_joint_2 = Integer(b_joint)
width_cut = Number(cutting_width_2)
h_joint_2 = Integer(h_joint)
height_4 = Number(height_2)
panel_7 = Panel(height_3)
panel_8 = Panel(joint_vertical)
panel_9 = Panel(depth_6)
panel_10 = Panel(joint_horizontal)
panel_11 = Panel(material_thickness_5)
panel_12 = Panel(thickness_cut)
panel_13 = Panel("""front:

height x width""")
panel_14 = Panel(height_4)
panel_15 = Panel(b_joint_2)
panel_16 = Panel(width_4)
panel_17 = Panel(h_joint_2)
panel_18 = Panel(material_thickness_6)
panel_19 = Panel(width_cut)
dikte = Number(material_thickness_5)
thickness_material = Number(material_thickness_2)
dikte_2 = Number(material_thickness_5)
hoogte = Number(height_3)
dikte_3 = Number(material_thickness_2)
hoogte_2 = Number(width_2)
dikte_4 = Number(material_thickness_6)
dikte_5 = Number(material_thickness_6)
subtraction = Subtraction(A=hoogte, B=dikte_2)
hoogte_3 = Number(height_4)
subtraction_2 = Subtraction(A=hoogte_2, B=dikte_3)
dikte_6 = Number(material_thickness_2)
dikte_7 = Number(material_thickness_5)
vert_pen = Integer(joints_vertical)
b_pen_3 = Integer(joint_vertical)
subtraction_3 = Subtraction(A=hoogte_3, B=dikte_4)
pt_d = ConstructPoint(XCoordinate=dikte_2, YCoordinate=subtraction, ZCoordinate="0")
pt_a = ConstructPoint(XCoordinate=dikte_5, YCoordinate=dikte_5, ZCoordinate="0")
pt_d_2 = ConstructPoint(XCoordinate=dikte_3, YCoordinate=subtraction_2, ZCoordinate="0")
pt_a_2 = ConstructPoint(XCoordinate=dikte_6, YCoordinate=dikte_6, ZCoordinate="0")
pt_a_3 = ConstructPoint(XCoordinate=dikte_7, YCoordinate=dikte_7, ZCoordinate="0")
pt_d_3 = ConstructPoint(XCoordinate=dikte_4, YCoordinate=subtraction_3, ZCoordinate="0")
dikte_8 = Number(material_thickness_6)
b_pen_4 = Integer(b_joint_2)
ln = Line(StartPoint=pt_d, EndPoint=pt_a_3)
offset = Offset(Curve=ln, Distance=dikte, Plane=PlaneXY(0, 0, 0), Corners=1)
divide = DivideCurve(Curve=offset, Count=b_pen_3, Kinks=False)  # -> Points, Tangents, Parameters
links_buiten = Point(divide.Points)
divide_2 = DivideCurve(Curve=ln, Count=b_pen_3, Kinks=False)  # -> Points, Tangents, Parameters
links_binnen = Point(divide_2.Points)
dikte_9 = Number(material_thickness_5)
ln_2 = Line(StartPoint=pt_d_2, EndPoint=pt_a_2)
offset_2 = Offset(Curve=ln_2, Distance=thickness_material, Plane=PlaneXY(0, 0, 0), Corners=1)
divide_offset_curve = DivideCurve(Curve=offset_2, Count=vert_pen, Kinks=False)  # -> Points, Tangents, Parameters
links_buiten_2 = Point(divide_offset_curve.Points)
divide_curve = DivideCurve(Curve=ln_2, Count=vert_pen, Kinks=False)  # -> Points, Tangents, Parameters
links_binnen_2 = Point(divide_curve.Points)
dikte_10 = Number(material_thickness_2)
ln_3 = Line(StartPoint=pt_d_3, EndPoint=pt_a)
offset_3 = Offset(Curve=ln_3, Distance=dikte_8, Plane=PlaneXY(0, 0, 0), Corners=1)
divide_3 = DivideCurve(Curve=offset_3, Count=b_pen_4, Kinks=False)  # -> Points, Tangents, Parameters
links_buiten_3 = Point(divide_3.Points)
divide_4 = DivideCurve(Curve=ln_3, Count=b_pen_4, Kinks=False)  # -> Points, Tangents, Parameters
links_binnen_3 = Point(divide_4.Points)
h_pen_3 = Integer(joint_horizontal)
hor_pen = Integer(joints_horizontal)
dikte_11 = Number(material_thickness_2)
dikte_12 = Number(material_thickness_5)
dikte_13 = Number(material_thickness_6)
h_pen_4 = Integer(joint_horizontal)
h_pen_5 = Integer(h_joint_2)
dikte_14 = Number(material_thickness_6)
h0r_pen = Integer(joints_horizontal)
h_pen_6 = Integer(h_joint_2)
dikte_15 = Number(material_thickness_6)
breedte = Number(depth_3)
hoogte_4 = Number(width_2)
dikte_16 = Number(material_thickness_2)
dikte_17 = Number(material_thickness_2)
dikte_18 = Number(material_thickness_2)
breedte_2 = Number(depth_3)
dikte_19 = Number(material_thickness_5)
subtraction_4 = Subtraction(A=breedte, B=dikte_17)
subtraction_5 = Subtraction(A=hoogte_4, B=dikte_16)
b_pen_5 = Integer(b_joint_2)
dikte_20 = Number(material_thickness_2)
breedte_3 = Number(depth_6)
dikte_21 = Number(material_thickness_5)
hoogte_5 = Number(height_3)
dikte_22 = Number(material_thickness_5)
breedte_4 = Number(depth_6)
dikte_23 = Number(material_thickness_5)
subtraction_6 = Subtraction(A=breedte_2, B=dikte_18)
subtraction_7 = Subtraction(A=breedte_3, B=dikte_23)
subtraction_8 = Subtraction(A=hoogte_5, B=dikte_22)
subtraction_9 = Subtraction(A=breedte_4, B=dikte_21)
breedte_5 = Number(width_4)
hoogte_6 = Number(height_4)
dikte_24 = Number(material_thickness_6)
dikte_25 = Number(material_thickness_6)
b_pen_6 = Integer(joint_vertical)
dikte_26 = Number(material_thickness_6)
breedte_6 = Number(width_4)
pt_c = ConstructPoint(XCoordinate=subtraction_4, YCoordinate=subtraction_5, ZCoordinate="0")
inner_contour = Line(StartPoint=pt_c, EndPoint=pt_d_2)
outer_contour = Offset(Curve=inner_contour, Distance=dikte_11, Plane=PlaneXY(0, 0, 0), Corners=1)
divide_5 = DivideCurve(Curve=outer_contour, Count=hor_pen, Kinks=False)  # -> Points, Tangents, Parameters
# construct coorinates of joint corners at inside and outside contour from length, width , height and material thickness
top_outer_points = Point(divide_5.Points)
divide_6 = DivideCurve(Curve=inner_contour, Count=hor_pen, Kinks=False)  # -> Points, Tangents, Parameters
top_inner_points = Point(divide_6.Points)
vert_pen_2 = Integer(joints_vertical)
pt_b = ConstructPoint(XCoordinate=subtraction_6, YCoordinate=dikte_18, ZCoordinate="0")
ln_4 = Line(StartPoint=pt_a_2, EndPoint=pt_b)
offset_4 = Offset(Curve=ln_4, Distance=dikte_10, Plane=PlaneXY(0, 0, 0), Corners=1)
divide_7 = DivideCurve(Curve=ln_4, Count=h0r_pen, Kinks=False)  # -> Points, Tangents, Parameters
onder_binnen = Point(divide_7.Points)
divide_8 = DivideCurve(Curve=offset_4, Count=h0r_pen, Kinks=False)  # -> Points, Tangents, Parameters
onder_buiten = Point(divide_8.Points)
ln_5 = Line(StartPoint=pt_b, EndPoint=pt_c)
offset_5 = Offset(Curve=ln_5, Distance=dikte_20, Plane=PlaneXY(0, 0, 0), Corners=1)
subtraction_10 = Subtraction(A=breedte_5, B=dikte_25)
subtraction_11 = Subtraction(A=hoogte_6, B=dikte_24)
subtraction_12 = Subtraction(A=breedte_6, B=dikte_26)
divide_9 = DivideCurve(Curve=ln_5, Count=vert_pen_2, Kinks=False)  # -> Points, Tangents, Parameters
divide_10 = DivideCurve(Curve=offset_5, Count=vert_pen_2, Kinks=False)  # -> Points, Tangents, Parameters
pt_b_2 = ConstructPoint(XCoordinate=subtraction_9, YCoordinate=dikte_21, ZCoordinate="0")
ln_6 = Line(StartPoint=pt_a_3, EndPoint=pt_b_2)
offset_6 = Offset(Curve=ln_6, Distance=dikte_9, Plane=PlaneXY(0, 0, 0), Corners=1)
divide_11 = DivideCurve(Curve=ln_6, Count=h_pen_4, Kinks=False)  # -> Points, Tangents, Parameters
onder_binnen_2 = Point(divide_11.Points)
divide_12 = DivideCurve(Curve=offset_6, Count=h_pen_4, Kinks=False)  # -> Points, Tangents, Parameters
onder_buiten_2 = Point(divide_12.Points)
pt_c_2 = ConstructPoint(XCoordinate=subtraction_7, YCoordinate=subtraction_8, ZCoordinate="0")
ln_7 = Line(StartPoint=pt_c_2, EndPoint=pt_d)
offset_7 = Offset(Curve=ln_7, Distance=dikte_12, Plane=PlaneXY(0, 0, 0), Corners=1)
divide_13 = DivideCurve(Curve=ln_7, Count=h_pen_3, Kinks=False)  # -> Points, Tangents, Parameters
boven_binnen = Point(divide_13.Points)
divide_14 = DivideCurve(Curve=offset_7, Count=h_pen_3, Kinks=False)  # -> Points, Tangents, Parameters
boven_buiten = Point(divide_14.Points)
ln_8 = Line(StartPoint=pt_b_2, EndPoint=pt_c_2)
offset_8 = Offset(Curve=ln_8, Distance=dikte_19, Plane=PlaneXY(0, 0, 0), Corners=1)
divide_15 = DivideCurve(Curve=ln_8, Count=b_pen_6, Kinks=False)  # -> Points, Tangents, Parameters
divide_16 = DivideCurve(Curve=offset_8, Count=b_pen_6, Kinks=False)  # -> Points, Tangents, Parameters
pt_c_3 = ConstructPoint(XCoordinate=subtraction_10, YCoordinate=subtraction_11, ZCoordinate="0")
ln_9 = Line(StartPoint=pt_c_3, EndPoint=pt_d_3)
offset_9 = Offset(Curve=ln_9, Distance=dikte_14, Plane=PlaneXY(0, 0, 0), Corners=1)
divide_17 = DivideCurve(Curve=ln_9, Count=h_pen_5, Kinks=False)  # -> Points, Tangents, Parameters
divide_18 = DivideCurve(Curve=offset_9, Count=h_pen_5, Kinks=False)  # -> Points, Tangents, Parameters
boven_binnen_2 = Point(divide_17.Points)
boven_buiten_2 = Point(divide_18.Points)
pt_b_3 = ConstructPoint(XCoordinate=subtraction_12, YCoordinate=dikte_26, ZCoordinate="0")
ln_10 = Line(StartPoint=pt_a, EndPoint=pt_b_3)
offset_10 = Offset(Curve=ln_10, Distance=dikte_13, Plane=PlaneXY(0, 0, 0), Corners=1)
divide_19 = DivideCurve(Curve=ln_10, Count=h_pen_6, Kinks=False)  # -> Points, Tangents, Parameters
onder_binnen_3 = Point(divide_19.Points)
divide_20 = DivideCurve(Curve=offset_10, Count=h_pen_6, Kinks=False)  # -> Points, Tangents, Parameters
onder_buiten_3 = Point(divide_20.Points)
ln_11 = Line(StartPoint=pt_b_3, EndPoint=pt_c_3)
offset_11 = Offset(Curve=ln_11, Distance=dikte_15, Plane=PlaneXY(0, 0, 0), Corners=1)
divide_21 = DivideCurve(Curve=ln_11, Count=b_pen_5, Kinks=False)  # -> Points, Tangents, Parameters
divide_22 = DivideCurve(Curve=offset_11, Count=b_pen_5, Kinks=False)  # -> Points, Tangents, Parameters
rechts_binnen = Point(divide_15.Points)
rechts_binnen_2 = Point(divide_21.Points)
rechts_buiten = Point(divide_16.Points)
rechts_binnen_3 = Point(divide_9.Points)
rechts_buiten_2 = Point(divide_22.Points)
rechts_buiten_3 = Point(divide_10.Points)
links_buiten_4 = Point(links_buiten)
links_buiten_5 = Point(links_buiten_3)
links_buiten_6 = Point(links_buiten_2)
links_binnen_4 = Point(links_binnen)
links_binnen_5 = Point(links_binnen_3)
links_binnen_6 = Point(links_binnen_2)
boven_binnen_3 = Point(boven_binnen)
boven_buiten_3 = Point(boven_buiten)
onder_binnen_4 = Point(onder_binnen_2)
onder_buiten_4 = Point(onder_buiten_2)
boven_binnen_4 = Point(boven_binnen_2)
boven_buiten_4 = Point(boven_buiten_2)
onder_binnen_5 = Point(onder_binnen_3)
onder_buiten_5 = Point(onder_buiten_3)
boven_binnen_5 = Point(top_inner_points)
# For convenience:
# clone inside and outside points
boven_buiten_5 = Point(top_outer_points)
onder_binnen_6 = Point(onder_binnen)
onder_buiten_6 = Point(onder_buiten)
rechts_binnen_4 = Point(rechts_binnen)
rechts_binnen_5 = Point(rechts_binnen_2)
rechts_binnen_6 = Point(rechts_binnen_3)
rechts_buiten_4 = Point(rechts_buiten)
rechts_buiten_5 = Point(rechts_buiten_2)
rechts_buiten_6 = Point(rechts_buiten_3)
links_binnen_7 = Point(links_binnen_4)
links_binnen_8 = Point(links_binnen_6)
links_buiten_7 = Point(links_buiten_4)
links_buiten_8 = Point(links_buiten_6)
links_binnen_9 = Point(links_binnen_5)
links_buiten_9 = Point(links_buiten_5)
panel_20 = Panel("""1
1
0
0""")
boven_binnen_6 = Point(links_buiten_7)
pt_ongeculd = Point(boven_binnen_6)
boven_binnen_7 = Point(links_buiten_8)
pt_ongeculd_2 = Point(boven_binnen_7)
cull_eerste = CullIndex(List=links_binnen_7, Indices="0", Wrap=False)
cull_eerste_2 = CullIndex(List=links_binnen_8, Indices="0", Wrap=False)
panel_21 = Panel("""1
1
0
0""")
cull_eerste_3 = CullIndex(List=links_buiten_9, Indices="0", Wrap=False)
viewer = ParamViewer(cull_eerste)
viewer_2 = ParamViewer(cull_eerste_2)
panel_22 = Panel("""1
1
0
0""")
lng = ListLength(List=cull_eerste)
lng_2 = ListLength(List=cull_eerste_2)
viewer_3 = ParamViewer(cull_eerste_3)
lng_3 = ListLength(List=cull_eerste_3)
addition = Addition(A=lng, B="-1")
addition_2 = Addition(A=lng_2, B="-1")
addition_3 = Addition(A=lng_3, B="-1")
cull_laatste = CullIndex(List=cull_eerste, Indices=addition, Wrap=False)
cull_laatste_2 = CullIndex(List=cull_eerste_2, Indices=addition_2, Wrap=False)
viewer_4 = ParamViewer(cull_laatste)
viewer_5 = ParamViewer(cull_laatste_2)
cull_laatste_3 = CullIndex(List=cull_eerste_3, Indices=addition_3, Wrap=False)
viewer_6 = ParamViewer(cull_laatste_3)
pt_na_culling = Point(cull_laatste)
pt_na_culling_2 = Point(pt_na_culling)
weave = Weave(Pattern=panel_21, Stream0=pt_na_culling_2, Stream1=pt_ongeculd, NullGaps=False)
viewer_7 = ParamViewer(weave)
simplify = SimplifyTree(Tree=weave, Front=False)
viewer_8 = ParamViewer(simplify)
pt_na_culling_3 = Point(cull_laatste_2)
pt_na_culling_4 = Point(pt_na_culling_3)
weave_2 = Weave(Pattern=panel_20, Stream0=pt_na_culling_4, Stream1=pt_ongeculd_2, NullGaps=False)
viewer_9 = ParamViewer(weave_2)
simplify_2 = SimplifyTree(Tree=weave_2, Front=False)
viewer_10 = ParamViewer(simplify_2)
zigzaglijn_punten = Point(simplify_2)
zigzaglijn_punten_2 = Point(simplify)
boven_binnen_8 = Point(links_binnen_9)
pt_ongeculd_3 = Point(boven_binnen_8)
pt_na_culling_5 = Point(cull_laatste_3)
pt_na_culling_6 = Point(pt_na_culling_5)
weave_3 = Weave(Pattern=panel_22, Stream0=pt_na_culling_6, Stream1=pt_ongeculd_3, NullGaps=False)
viewer_11 = ParamViewer(weave_3)
simplify_3 = SimplifyTree(Tree=weave_3, Front=False)
viewer_12 = ParamViewer(simplify_3)
zigzaglijn_punten_3 = Point(simplify_3)
boven_binnen_9 = Point(boven_binnen_5)
boven_buiten_6 = Point(boven_buiten_5)
onder_binnen_7 = Point(onder_binnen_4)
onder_buiten_7 = Point(onder_buiten_4)
boven_binnen_10 = Point(boven_binnen_3)
boven_buiten_7 = Point(boven_buiten_3)
onder_binnen_8 = Point(onder_binnen_6)
onder_buiten_8 = Point(onder_buiten_6)
cull_eerste_4 = CullIndex(List=boven_binnen_9, Indices="0", Wrap=False)
boven_binnen_11 = Point(boven_buiten_6)
cull_eerste_5 = CullIndex(List=onder_buiten_7, Indices="0", Wrap=False)
onder_binnen_9 = Point(onder_binnen_5)
boven_binnen_12 = Point(boven_binnen_4)
onder_buiten_9 = Point(onder_buiten_5)
boven_buiten_8 = Point(boven_buiten_4)
panel_23 = Panel("""1
1
0
0""")
# construction of joints:
# 
# skip first and last points where necessary and Weave the remaining points in 1100 pattern
viewer_13 = ParamViewer(cull_eerste_4)
lng_4 = ListLength(List=cull_eerste_4)
cull_eerste_6 = CullIndex(List=boven_buiten_7, Indices="0", Wrap=False)
viewer_14 = ParamViewer(cull_eerste_5)
panel_24 = Panel("""1
1
0
0""")
panel_25 = Panel("""1
1
0
0""")
lng_5 = ListLength(List=cull_eerste_5)
cull_eerste_7 = CullIndex(List=onder_binnen_8, Indices="0", Wrap=False)
viewer_15 = ParamViewer(cull_eerste_6)
boven_binnen_13 = Point(onder_buiten_8)
pt_ongeculd_4 = Point(boven_binnen_13)
lng_6 = ListLength(List=cull_eerste_6)
cull_eerste_8 = CullIndex(List=boven_buiten_8, Indices="0", Wrap=False)
cull_eerste_9 = CullIndex(List=onder_buiten_9, Indices="0", Wrap=False)
viewer_16 = ParamViewer(cull_eerste_7)
panel_26 = Panel("""1
1
0
0""")
addition_4 = Addition(A=lng_4, B="-1")
panel_27 = Panel("""1
1
0
0""")
lng_7 = ListLength(List=cull_eerste_7)
viewer_17 = ParamViewer(cull_eerste_8)
viewer_18 = ParamViewer(cull_eerste_9)
addition_5 = Addition(A=lng_5, B="-1")
lng_8 = ListLength(List=cull_eerste_8)
cull_laatste_4 = CullIndex(List=cull_eerste_4, Indices=addition_4, Wrap=False)
lng_9 = ListLength(List=cull_eerste_9)
addition_6 = Addition(A=lng_6, B="-1")
viewer_19 = ParamViewer(cull_laatste_4)
cull_laatste_5 = CullIndex(List=cull_eerste_5, Indices=addition_5, Wrap=False)
addition_7 = Addition(A=lng_7, B="-1")
viewer_20 = ParamViewer(cull_laatste_5)
cull_laatste_6 = CullIndex(List=cull_eerste_6, Indices=addition_6, Wrap=False)
addition_8 = Addition(A=lng_8, B="-1")
addition_9 = Addition(A=lng_9, B="-1")
viewer_21 = ParamViewer(cull_laatste_6)
cull_laatste_7 = CullIndex(List=cull_eerste_7, Indices=addition_7, Wrap=False)
viewer_22 = ParamViewer(cull_laatste_7)
pt_na_culling_7 = Point(cull_laatste_4)
cull_laatste_8 = CullIndex(List=cull_eerste_8, Indices=addition_8, Wrap=False)
cull_laatste_9 = CullIndex(List=cull_eerste_9, Indices=addition_9, Wrap=False)
boven_binnen_14 = Point(onder_binnen_7)
pt_ongeculd_5 = Point(boven_binnen_14)
pt_na_culling_8 = Point(cull_laatste_5)
pt_na_culling_9 = Point(pt_na_culling_8)
weave_4 = Weave(Pattern=panel_23, Stream0=pt_na_culling_9, Stream1=pt_ongeculd_5, NullGaps=False)
viewer_23 = ParamViewer(weave_4)
simplify_4 = SimplifyTree(Tree=weave_4, Front=False)
viewer_24 = ParamViewer(simplify_4)
viewer_25 = ParamViewer(cull_laatste_8)
viewer_26 = ParamViewer(cull_laatste_9)
zigzaglijn_punten_4 = Point(simplify_4)
boven_binnen_15 = Point(boven_binnen_10)
pt_ongeculd_6 = Point(boven_binnen_15)
pt_na_culling_10 = Point(cull_laatste_6)
pt_na_culling_11 = Point(pt_na_culling_10)
weave_5 = Weave(Pattern=panel_25, Stream0=pt_na_culling_11, Stream1=pt_ongeculd_6, NullGaps=False)
viewer_27 = ParamViewer(weave_5)
simplify_5 = SimplifyTree(Tree=weave_5, Front=False)
viewer_28 = ParamViewer(simplify_5)
zigzaglijn_punten_5 = Point(simplify_5)
pt_na_culling_12 = Point(cull_laatste_7)
pt_na_culling_13 = Point(pt_na_culling_12)
weave_6 = Weave(Pattern=panel_24, Stream0=pt_na_culling_13, Stream1=pt_ongeculd_4, NullGaps=False)
viewer_29 = ParamViewer(weave_6)
simplify_6 = SimplifyTree(Tree=weave_6, Front=False)
viewer_30 = ParamViewer(simplify_6)
zigzaglijn_punten_6 = Point(simplify_6)
boven_binnen_16 = Point(boven_binnen_12)
pt_ongeculd_7 = Point(boven_binnen_16)
boven_binnen_17 = Point(onder_binnen_9)
pt_ongeculd_8 = Point(boven_binnen_17)
pt_na_culling_14 = Point(pt_na_culling_7)
pt_ongeculd_9 = Point(boven_binnen_11)
pt_na_culling_15 = Point(cull_laatste_8)
pt_na_culling_16 = Point(pt_na_culling_15)
weave_7 = Weave(Pattern=panel_26, Stream0=pt_na_culling_16, Stream1=pt_ongeculd_7, NullGaps=False)
viewer_31 = ParamViewer(weave_7)
simplify_7 = SimplifyTree(Tree=weave_7, Front=False)
viewer_32 = ParamViewer(simplify_7)
pt_na_culling_17 = Point(cull_laatste_9)
pt_na_culling_18 = Point(pt_na_culling_17)
weave_8 = Weave(Pattern=panel_27, Stream0=pt_na_culling_18, Stream1=pt_ongeculd_8, NullGaps=False)
viewer_33 = ParamViewer(weave_8)
simplify_8 = SimplifyTree(Tree=weave_8, Front=False)
viewer_34 = ParamViewer(simplify_8)
rechts_binnen_7 = Point(rechts_binnen_6)
rechts_buiten_7 = Point(rechts_buiten_6)
zigzaglijn_punten_7 = Point(simplify_7)
zigzaglijn_punten_8 = Point(simplify_8)
rechts_binnen_8 = Point(rechts_binnen_4)
rechts_buiten_8 = Point(rechts_buiten_4)
panel_28 = Panel("""1
1
0
0""")
weave_9 = Weave(Pattern=panel_28, Stream0=pt_na_culling_14, Stream1=pt_ongeculd_9, NullGaps=False)
rechts_binnen_9 = Point(rechts_binnen_5)
rechts_buiten_9 = Point(rechts_buiten_5)
viewer_35 = ParamViewer(weave_9)
cull_eerste_10 = CullIndex(List=rechts_binnen_7, Indices="0", Wrap=False)
cull_eerste_11 = CullIndex(List=rechts_binnen_8, Indices="0", Wrap=False)
boven_binnen_18 = Point(rechts_buiten_7)
pt_ongeculd_10 = Point(boven_binnen_18)
panel_29 = Panel("""1
1
0
0""")
panel_30 = Panel("""1
1
0
0""")
viewer_36 = ParamViewer(cull_eerste_10)
viewer_37 = ParamViewer(cull_eerste_11)
panel_31 = Panel("""1
1
0
0""")
lng_10 = ListLength(List=cull_eerste_10)
cull_eerste_12 = CullIndex(List=rechts_buiten_9, Indices="0", Wrap=False)
lng_11 = ListLength(List=cull_eerste_11)
boven_binnen_19 = Point(rechts_buiten_8)
pt_ongeculd_11 = Point(boven_binnen_19)
simplify_9 = SimplifyTree(Tree=weave_9, Front=False)
viewer_38 = ParamViewer(cull_eerste_12)
lng_12 = ListLength(List=cull_eerste_12)
viewer_39 = ParamViewer(simplify_9)
addition_10 = Addition(A=lng_10, B="-1")
addition_11 = Addition(A=lng_11, B="-1")
cull_laatste_10 = CullIndex(List=cull_eerste_10, Indices=addition_10, Wrap=False)
cull_laatste_11 = CullIndex(List=cull_eerste_11, Indices=addition_11, Wrap=False)
addition_12 = Addition(A=lng_12, B="-1")
viewer_40 = ParamViewer(cull_laatste_10)
viewer_41 = ParamViewer(cull_laatste_11)
zigzaglijn_punten_9 = Point(simplify_9)
cull_laatste_12 = CullIndex(List=cull_eerste_12, Indices=addition_12, Wrap=False)
viewer_42 = ParamViewer(cull_laatste_12)
pt_na_culling_19 = Point(cull_laatste_10)
pt_na_culling_20 = Point(pt_na_culling_19)
weave_10 = Weave(Pattern=panel_29, Stream0=pt_na_culling_20, Stream1=pt_ongeculd_10, NullGaps=False)
viewer_43 = ParamViewer(weave_10)
simplify_10 = SimplifyTree(Tree=weave_10, Front=False)
viewer_44 = ParamViewer(simplify_10)
zigzaglijn_punten_10 = Point(simplify_10)
pt_na_culling_21 = Point(cull_laatste_11)
pt_na_culling_22 = Point(pt_na_culling_21)
weave_11 = Weave(Pattern=panel_30, Stream0=pt_na_culling_22, Stream1=pt_ongeculd_11, NullGaps=False)
viewer_45 = ParamViewer(weave_11)
simplify_11 = SimplifyTree(Tree=weave_11, Front=False)
viewer_46 = ParamViewer(simplify_11)
zigzaglijn_punten_11 = Point(simplify_11)
boven_binnen_20 = Point(rechts_binnen_9)
pt_ongeculd_12 = Point(boven_binnen_20)
pt_na_culling_23 = Point(cull_laatste_12)
pt_na_culling_24 = Point(pt_na_culling_23)
weave_12 = Weave(Pattern=panel_31, Stream0=pt_na_culling_24, Stream1=pt_ongeculd_12, NullGaps=False)
viewer_47 = ParamViewer(weave_12)
simplify_12 = SimplifyTree(Tree=weave_12, Front=False)
viewer_48 = ParamViewer(simplify_12)
zigzaglijn_punten_12 = Point(simplify_12)
pline = PolyLine(Vertices=zigzaglijn_punten, Closed=False)
pline_2 = PolyLine(Vertices=zigzaglijn_punten_2, Closed=False)
# for convenience:
# 
# cloine outlines
pline_3 = PolyLine(Vertices=zigzaglijn_punten_9, Closed=False)
pline_4 = PolyLine(Vertices=zigzaglijn_punten_3, Closed=False)
pline_5 = PolyLine(Vertices=zigzaglijn_punten_6, Closed=False)
pline_6 = PolyLine(Vertices=zigzaglijn_punten_5, Closed=False)
pline_7 = PolyLine(Vertices=zigzaglijn_punten_4, Closed=False)
pline_8 = PolyLine(Vertices=zigzaglijn_punten_7, Closed=False)
pline_9 = PolyLine(Vertices=zigzaglijn_punten_8, Closed=False)
pline_10 = PolyLine(Vertices=zigzaglijn_punten_10, Closed=False)
pline_11 = PolyLine(Vertices=zigzaglijn_punten_11, Closed=False)
pline_12 = PolyLine(Vertices=zigzaglijn_punten_12, Closed=False)
join = JoinCurves(Curves=[pline_10, pline_3, pline, pline_5], Preserve=False)
join_2 = JoinCurves(Curves=[pline_11, pline_6, pline_2, pline_7], Preserve=False)
d_snede = Number(cutting_width_3)
offset_12 = Panel(d_snede)
d_snede_2 = Number(thickness_cut)
offset_13 = Panel(d_snede_2)
type = Panel("1")
# construct cutting lines considering tooldiameter: offset lines
offset_14 = Offset(Curve=join, Distance=d_snede, Plane=PlaneXY(0, 0, 0), Corners=type)
join_3 = JoinCurves(Curves=[pline_12, pline_8, pline_4, pline_9], Preserve=False)
type_2 = Panel("1")
offset_15 = Offset(Curve=join_2, Distance=d_snede_2, Plane=PlaneXY(0, 0, 0), Corners=type_2)
d_snede_3 = Number(width_cut)
offset_16 = Panel(d_snede_3)
type_3 = Panel("1")
offset_17 = Offset(Curve=join_3, Distance=d_snede_3, Plane=PlaneXY(0, 0, 0), Corners=type_3)
slider_y = Slider(10, range=-200..500)
slider_y_2 = Slider(10, range=-200..50)
slider_y_3 = Slider(5, range=-200..50)
slider_x = Slider(10, range=-100..50)
hoogte_7 = ClusterInput()
hoogte_8 = Number(hoogte_7)
slider_y_4 = Slider(5, range=-200..50)
slider_x_2 = Slider(15, range=-100..50)
X = UnitX(Factor=slider_x)
Y = UnitY(Factor=slider_y_3)
addition_13 = Addition(A=hoogte_8, B=slider_y)
Y_2 = UnitY(Factor=addition_13)
# move lines to make them well visible
X_2 = UnitX(Factor=slider_y_2)
move = Move(Geometry=offset_14, Translation=X_2)  # -> Geometry, Transform
move_2 = Move(Geometry=offset_15, Translation=Y)  # -> Geometry, Transform
diepte = Number(depth_4)
addition_14 = Addition(A=diepte, B=slider_x_2)
move_3 = Move(Geometry=move.Geometry, Translation=Y_2)  # -> Geometry, Transform
move_4 = Move(Geometry=move_2.Geometry, Translation=X)  # -> Geometry, Transform
X_3 = UnitX(Factor=addition_14)
Y_3 = UnitY(Factor=slider_y_4)
move_5 = Move(Geometry=offset_17, Translation=Y_3)  # -> Geometry, Transform
move_6 = Move(Geometry=move_5.Geometry, Translation=X_3)  # -> Geometry, Transform
# close curves by extending lines
# 
# these curves will be sent to bake panel under dimension input
d_snede_4 = Number(cutting_width_3)
materiaal_dikte = Number(material_thickness_2)
d_snede_5 = Number(cutting_width_3)
materiaal_dikte_2 = Number(material_thickness_2)
d_snede_6 = Number(cutting_width_3)
materiaal_dikte_3 = Number(material_thickness_2)
addition_15 = Addition(A=d_snede_4, B=materiaal_dikte)
addition_16 = Addition(A=d_snede_5, B=materiaal_dikte_2)
addition_17 = Addition(A=d_snede_6, B=materiaal_dikte_3)
ext = ExtendCurve(Curve=move_3.Geometry, Type=0, Start=addition_15, End=addition_15)
ext_2 = ExtendCurve(Curve=move_6.Geometry, Type=0, Start=addition_16, End=addition_16)
ext_3 = ExtendCurve(Curve=move_4.Geometry, Type=0, Start=addition_17, End=addition_17)
C = ClusterOutput(ext)
C_2 = ClusterOutput(ext_2)
C_3 = ClusterOutput(ext_3)

# ==== cluster Tag
C = ClusterInput()
T = ClusterInput()
T_2 = ClusterInput()
simplify = SimplifyTree(Tree=T, Front=False)
simplify_2 = SimplifyTree(Tree=T_2, Front=False)
panel = ClusterOutput("front")
end = EndPoints(Curve=C)  # -> Start, End
S = ClusterOutput(end.Start)
panel_2 = Panel(simplify_2)
branch = TreeBranch(Tree=simplify_2, Path="{0;0}", MaintainPaths=True)
branch_2 = TreeBranch(Tree=simplify, Path="{0}", MaintainPaths=True)
panel_3 = Panel(simplify)
end_2 = EndPoints(Curve=branch)  # -> Start, End
S_2 = ClusterOutput(end_2.Start)
end_3 = EndPoints(Curve=branch_2)  # -> Start, End
S_3 = ClusterOutput(end_3.Start)
panel_4 = ClusterOutput("side")
panel_5 = ClusterOutput("top")
