# Grasshopper definition rechte extrusie.gh (Grasshopper 0.9.75)

# ---- group: strel hiermee extrusie afstand in
number_slider = Slider(6, range=0..100)

# ---- group: selecteer hiermee curve
crv = Curve(<curve referenced from the Rhino model>)

# ---- group: verbind met de gewenste richtingsvector
Z = UnitZ(Factor=number_slider)
Z_2 = UnitZ(Factor=number_slider)
Y = UnitY(Factor=number_slider)

# ---- group: deze maakt rechte extrusie
extr = Extrude(Base=crv, Direction=Z_2)

# ---- group: deze sluit gaten
capex = CapHolesEx(Brep=extr)  # -> Brep, Caps, Solid

# ---- group: deze bakken
brep = Brep(capex.Brep)

# ----
panel = Panel(capex.Caps)
